# Grasshopper definition temp.gh (Grasshopper 1.0.7)
# plug-ins: Axolotl Info

number_slider = Slider(5, range=0..10)
# C:\Zac\19 Github\ZacZhangzhuo.github.io\tools\zAddItems.py
panel = Panel("C:\Zac\19 Github\zorse\temp.py")
sphere = Sphere(Radius=Slider(7, range=0..10), Center=Point(0, 0, 0))
number_slider_2 = Slider(69, range=0..100)
ellipsoid = Ellipsoid(RadiusX=number_slider, RadiusY=number_slider, RadiusZ=Slider(1, range=0..10), Plane=PlaneXY(0, 0, 0))
read_file = ReadFile(File=panel, PerLineParse=False)
twist = Twist(Angle=0, Plane=PlaneXY(0, 0, 0))
box = Box(DimensionX=8, DimensionY=7, DimensionZ=6, Radius=0, Plane=PlaneXY(0, 0, 0))
array_limited = ArrayLimited(CellsizeX=1, CellsizeY=1, CellsizeZ=1, NumberX=2, NumberY=2, NumberZ=2)
ghpython_script = GhPythonScript(Code=read_file)  # -> Out, A
isosurface_distancefunction = IsosurfaceDistancefunction(
    NumberX=number_slider_2,
    NumberY=number_slider_2,
    NumberZ=number_slider_2,
    Isovalue=0,
    Capped=False,
    DistanceObject=ellipsoid,
    Refine=True)
panel_2 = Panel(ghpython_script.Out)
geometry = Geometry(isosurface_distancefunction)
