# Grasshopper definition visualization.ghx (Grasshopper 1.0.7)

panel = Panel("C:\Zac\GitHub\ZacZhangzhuo.github.io\father.json")
panel_2 = Panel("C:\Users\Zac\Desktop")
read_file = ReadFile(PerLineParse=False)
panel_3 = Panel("C:\Zac\GitHub\ZacZhangzhuo.github.io\son.json")
_0_to_1_00 = Slider(0, range=0..1)
_1_to_100 = Slider(0, range=0..100)
ghpython_script = GhPythonScript(fatherLocation=panel, sonLocation=panel_3)  # -> out, links
# ---------- ghpython_script: Python ----------
from compas import json_load
import Rhino.Geometry as rg

fatherData = json_load (fatherLocation)
sonData = json_load (sonLocation)
theLinks = [d["Links"] for d in fatherData]



links = []
for L in range(len(theLinks)):

    for l in theLinks[L]:
        p1 = rg.Point3d(fatherData[L]["Point"][0],fatherData[L]["Point"][1],fatherData[L]["Point"][2])
        p2 = rg.Point3d(sonData[l]["Point"][0],sonData[l]["Point"][1],sonData[l]["Point"][2])
        links.append(rg.Line(p1,p2))
# ---------- end ghpython_script ----------
c_script = CSharpScript()  # -> Out, A
ghpython_script_2 = GhPythonScript(location=panel)  # -> out, points, radiuses, links
# ---------- ghpython_script_2: Python ----------
from compas import json_load
import Rhino.Geometry as rg
data = json_load (location)


radiuses = [d["Radius"]*d["Scale"]  for d in data]
thePoints = [d["Point"] for d in data]


points = []
for p in thePoints:
    points.append(rg.Point3d(p[0],p[1],p[2]))
# ---------- end ghpython_script_2 ----------
ghpython_script_3 = GhPythonScript(location=panel_3)  # -> out, points, radiuses
# ---------- ghpython_script_3: Python ----------
from compas import json_load
import Rhino.Geometry as rg
data = json_load (location)


radiuses = [d["Radius"]*d["Scale"]  for d in data]
thePoints = [d["Point"] for d in data]

points = []
for p in thePoints:
    points.append(rg.Point3d(p[0],p[1],p[2]))
# ---------- end ghpython_script_3 ----------
integer = Integer()
sphere = Sphere(Base=ghpython_script_2.points, Radius=ghpython_script_2.radiuses)
panel_4 = Panel(ghpython_script_2.links)
pipe = Pipe(Curve=ghpython_script.links, Radius=0.2, Caps=0)
sphere_2 = Sphere(Base=ghpython_script_3.points, Radius=ghpython_script_3.radiuses)
