# Grasshopper definition Snake.gh (Grasshopper 1.0.7)
# plug-ins: Pufferfish

md_slider = MDSlider(
    SliderMode=0,
    slider_value=Point(0.4934146695, 0.133320506, 0.5),
    x_domain=Domain(0, 1),
    y_domain=Domain(0, 1),
    z_domain=Domain(0, 1))
trigger = Trigger(Interval=10, TimerInterval=10, Target=ghpython_script)  # disabled
ghpython_script = GhPythonScript(Direction=md_slider, FoodRange="200", Run=Toggle(True), Reset=Button())  # -> out, Snake, Foods, Score, Bound, Tails, Dots; inputs Direction: Point3d, Run: Boolean, Reset: Boolean
# ---------- ghpython_script: Python ----------
import scriptcontext as sc
import rhinoscriptsyntax as rs
import random
import Rhino.Geometry as rg
import copy
import math

def UnitizePoint(point):
    point = rg.Vector3d(point.X,point.Y,0)
    rg.Vector3d.Unitize(point)
    point = rg.Point3d(point.X,point.Y,0)
    return point

def DirectionalMove (Direction):
    DirectionVec = rg.Vector3d(Direction.X-0.5, Direction.Y-0.5,0)
    rg.Vector3d.Unitize(DirectionVec)
    VecX = rg.Vector3d.XAxis

    if DirectionVec.Y >= 0:
      if DirectionVec*VecX > math.cos(math.pi/8):
         DirectionVec = rg.Vector3d(1,0,0)
      elif  DirectionVec*VecX <= math.cos(math.pi/8) and DirectionVec*VecX > math.cos(math.pi*3/8):
           DirectionVec = rg.Vector3d(1,1,0)
      elif  DirectionVec*VecX <= math.cos(math.pi*3/8) and DirectionVec*VecX > math.cos(math.pi*5/8):
           DirectionVec = rg.Vector3d(0,1,0)
      elif  DirectionVec*VecX <= math.cos(math.pi*5/8) and DirectionVec*VecX > math.cos(math.pi*7/8):
          DirectionVec = rg.Vector3d(-1,1,0)
      elif  DirectionVec*VecX <= math.cos(math.pi*7/8):
          DirectionVec = rg.Vector3d(-1,0,0)
    else:
     if DirectionVec*VecX > math.cos(math.pi/8):
          DirectionVec = rg.Vector3d(1,0,0)
     elif  DirectionVec*VecX <= math.cos(math.pi/8) and DirectionVec*VecX > math.cos(math.pi*3/8):
         DirectionVec = rg.Vector3d(1,-1,0)
     elif  DirectionVec*VecX <= math.cos(math.pi*3/8) and DirectionVec*VecX > math.cos(math.pi*5/8):
         DirectionVec = rg.Vector3d(0,-1,0)
     elif  DirectionVec*VecX <= math.cos(math.pi*5/8) and DirectionVec*VecX > math.cos(math.pi*7/8):
         DirectionVec = rg.Vector3d(-1,-1,0)
     elif  DirectionVec*VecX <= math.cos(math.pi*7/8):
         DirectionVec = rg.Vector3d(-1,0,0)

    rg.Vector3d.Unitize(DirectionVec)
    return DirectionVec

scale = 0.03
tailLength = 20
dotRange = 50
Direction = DirectionalMove(Direction)
snakeCircles = []
tailCircles = []
dots = []

# Add the variables to the sticky dict
if "snakeLocations" not in sc.sticky:
    sc.sticky["snakeLocations"] = []
    sc.sticky["snakeLocations"].append(rg.Point3d(0,0,0))

if "foodLocation" not in sc.sticky:
    sc.sticky["foodLocation"] = rg.Point3d(0,0,0)
    
if "score" not in sc.sticky:
    sc.sticky["score"] = 0
    
if "Tails" not in sc.sticky:
    sc.sticky["Tails"] = []
    
#Die
if sc.sticky["snakeLocations"][0].X > FoodRange or sc.sticky["snakeLocations"][0].X < -FoodRange or sc.sticky["snakeLocations"][0].Y > FoodRange or sc.sticky["snakeLocations"][0].Y < -FoodRange:
    Run = False

# Run
if Reset:
    sc.sticky["score"] = 0
    sc.sticky["snakeLocations"] = []
    sc.sticky["Tails"] = []
    sc.sticky["snakeLocations"].append(rg.Point3d(0,0,0))
    random.seed(1)
    sc.sticky["foodLocation"] = rg.Point3d(random.uniform(-FoodRange,FoodRange),random.uniform(-FoodRange,FoodRange),0)
    
elif not Run:
    print 'NOT Runing'
    
else:
    #With trigger
    if len(sc.sticky["snakeLocations"]) <= 1:
        sc.sticky["snakeLocations"][0].X += Direction.X
        sc.sticky["snakeLocations"][0].Y += Direction.Y
    else:
        tempSnake = copy.deepcopy(sc.sticky["snakeLocations"])
        for i in range(len(sc.sticky["snakeLocations"])):
            sc.sticky["snakeLocations"][i].X = tempSnake[i-1].X
            sc.sticky["snakeLocations"][i].Y = tempSnake[i-1].Y

        sc.sticky["Tails"].append(copy.deepcopy(sc.sticky["snakeLocations"][0]))
        if len(sc.sticky["Tails"]) >= tailLength:
            sc.sticky["Tails"].pop(0)

        sc.sticky["snakeLocations"][0].X = sc.sticky["snakeLocations"][1].X+Direction.X
        sc.sticky["snakeLocations"][0].Y = sc.sticky["snakeLocations"][1].Y+Direction.Y

    if rg.Point3d.DistanceTo(sc.sticky["snakeLocations"][0], sc.sticky["foodLocation"]) < scale*FoodRange :
        sc.sticky["score"] += 1
        sc.sticky["snakeLocations"].append(rg.Point3d(sc.sticky["snakeLocations"][-1].X-Direction.X,sc.sticky["snakeLocations"][-1].Y-Direction.Y,0))
        sc.sticky["foodLocation"] = rg.Point3d(random.uniform(-FoodRange,FoodRange),random.uniform(-FoodRange,FoodRange),0)

# Return value
for snakeLocations in sc.sticky["snakeLocations"]:
    snakeCircles.append(rg.Circle(rg.Plane(snakeLocations,rg.Vector3d.ZAxis), 1))
Score = 'Score: ' + str(sc.sticky["score"])

Snake = snakeCircles
Foods = rg.Circle(rg.Plane(sc.sticky["foodLocation"],rg.Vector3d.ZAxis), scale*FoodRange)
Bound = rg.Rectangle3d(rg.Plane(rg.Point3d(-FoodRange,-FoodRange,0),rg.Vector3d.ZAxis),2*FoodRange,2*FoodRange)

for Tails in sc.sticky["Tails"]:
    tailCircles.append(rg.Circle(rg.Plane(Tails,rg.Vector3d.ZAxis), 1))
Tails = tailCircles

for i in range(dotRange):
    for j in range(dotRange):
        dots.append(rg.Point3d(FoodRange/dotRange+i*(2*FoodRange/dotRange)-FoodRange, FoodRange/dotRange+j*(2*FoodRange/dotRange)-FoodRange, 0))
        
Dots = dots
# ---------- end ghpython_script ----------
panel = Panel(ghpython_script.Snake)
geometry = Geometry(ghpython_script.Snake)

list_length = ListLength(List=ghpython_script.Tails)
list_indices = ListIndices(List=ghpython_script.Tails)
gradient = Gradient(LowerLimit=0, UpperLimit=list_length, Parameter=list_indices, stops=[0: RGB(255, 255, 255), 1: RGB(128, 128, 128)])
boundary_surfaces = BoundarySurfaces(Edges=ghpython_script.Snake)
boundary_surfaces_2 = BoundarySurfaces(Edges=ghpython_script.Foods)
boundary_surfaces_3 = BoundarySurfaces(Edges=ghpython_script.Tails)
xy_plane = XYPlane(Origin=Point(0, 0, 0))
text_tag_3d = TextTag3D(
    Location=xy_plane,
    Text=ghpython_script.Score,
    Size=Slider(10, range=0..10),
    Colour=ColourSwatch(SwatchColor=RGBA(0, 0, 0, 187)),
    Justification=5)
custom_preview = CustomPreview(Geometry=boundary_surfaces, Material=ColourSwatch(SwatchColor=RGB(18, 0, 133)))
custom_preview_2 = CustomPreview(Geometry=boundary_surfaces_2, Material=ColourSwatch(SwatchColor=RGBA(0, 0, 0, 129)))
custom_preview_3 = CustomPreview(Geometry=boundary_surfaces_3, Material=gradient)
cloud_display = CloudDisplay(
    Points=ghpython_script.Dots,
    Colours=ColourSwatch(SwatchColor=RGBA(0, 0, 0, 24)),
    Size=Slider(2, range=0..10),
    SpriteType=0)
curve_display = CurveDisplay(Curve=ghpython_script.Bound, Width=Slider(2, range=0..10), Colour=ColourSwatch(SwatchColor=RGB(0, 0, 0)))  # inputs Curve: Curve, Width: Int32, Colour: Color, Dash: String
# ---------- curve_display: C# ----------
    if (Curve == null) return;
    if (Width <= 0) return;

    double[] pattern = ParseDashPattern(Dash);
    IEnumerable<Curve> segments = ApplyDashPattern(Curve, pattern);

    _clip = BoundingBox.Union(_clip, Curve.GetBoundingBox(false));
    foreach (Curve segment in segments)
    {
      _curves.Add(segment);
      _colors.Add(Colour);
      _widths.Add(Width);
    }
# ---------- curve_display: C# additional code ----------
  /// <summary>
  /// Parse a dash pattern.
  /// </summary>
  /// <param name="pattern">Pattern to parse.</param>
  /// <returns>Array of dashes and gaps.</returns>
  private double[] ParseDashPattern(string pattern)
  {
    if (string.IsNullOrWhiteSpace(pattern))
      return null;

    string[] fragments = pattern.Split(new char[] {' '});
    if (fragments == null || fragments.Length == 0)
      return null;

    double[] values = new double[fragments.Length];
    for (int i = 0; i < fragments.Length; i++)
    {
      double v;
      if (!double.TryParse(fragments[i], out v))
        throw new Exception(fragments[i] + " is a not a valid number.");

      if (v <= 0.0)
        throw new Exception("Dashes or gaps must have a strictly positive length.");

      values[i] = v;
    }

    return values;
  }
  /// <summary>
  /// Apply a dash+gap pattern to a curve.
  /// </summary>
  private IEnumerable<Curve> ApplyDashPattern(Curve curve, double[] pattern)
  {
    if (pattern == null || pattern.Length == 0)
      return new Curve[] { curve };

    double curveLength = curve.GetLength();
    List<Curve> dashes = new List<Curve>();

    double offset0 = 0.0;
    int index = 0;
    while(true)
    {
      // Get the current dash length.
      double dashLength = pattern[index++];
      if (index >= pattern.Length)
        index = 0;

      // Compute the offset of the current dash from the curve start.
      double offset1 = offset0 + dashLength;
      if (offset1 > curveLength)
        offset1 = curveLength;

      // Solve the curve parameters at the current dash start and end.
      double t0, t1;
      curve.LengthParameter(offset0, out t0);
      curve.LengthParameter(offset1, out t1);

      Curve dash = curve.Trim(t0, t1);
      if (dash != null)
        dashes.Add(dash);

      // Get the current gap length.
      double gapLength = pattern[index++];
      if (index >= pattern.Length)
        index = 0;

      // Set the start of the next dash to be the end of the current
      // dash + the length of the adjacent gap.
      offset0 = offset1 + gapLength;

      // Abort when we've reached the end of the curve.
      if (offset0 >= curveLength)
        break;
    }

    return dashes;
  }

  private BoundingBox _clip;
  private readonly List<Curve> _curves = new List<Curve>();
  private readonly List<Color> _colors = new List<Color>();
  private readonly List<int> _widths = new List<int>();

  /// <summary>
  /// This method will be called once every solution, before any calls to RunScript.
  /// </summary>
  public override void BeforeRunScript()
  {
    _clip = BoundingBox.Empty;
    _curves.Clear();
    _colors.Clear();
    _widths.Clear();
  }

  /// <summary>
  /// Return a BoundingBox that contains all the geometry you are about to draw.
  /// </summary>
  public override BoundingBox ClippingBox
  {
    get { return _clip; }
  }
  /// <summary>
  /// Draw all wires and points in this method.
  /// </summary>
  public override void DrawViewportWires(IGH_PreviewArgs args)
  {
    for (int i = 0; i < _curves.Count; i++)
      args.Display.DrawCurve(_curves[i], _colors[i], _widths[i]);
  }
# ---------- end curve_display ----------
