# Grasshopper definition flag.gh (Grasshopper 1.0.7)

sphere = Sphere(Base=PlaneXY(0, 0, 0), Radius=Slider(7, range=0..10))

read_file = ReadFile(File="C:\Users\Zac\Desktop\ChinaFlag.py", PerLineParse=False)
point = Point([Point(432.8587048, 1347.341338, 0), Point(680.2371981, 1663.725411, 0), Point(835.1742544, 1490.560465, 0), Point(804.9251399, 1212.590825, 0), Point(635.9694677, 977.5755899, 0)])
ghpython_script = GhPythonScript(Code=read_file, Patterns=point)  # -> Out, RectangleSurface, Stars
panel = Panel(ghpython_script.Out)
custom_preview = CustomPreview(Geometry=ghpython_script.RectangleSurface, Material=ColourSwatch(SwatchColor=RGB(255, 0, 0)))
custom_preview_2 = CustomPreview(Geometry=ghpython_script.Stars, Material=ColourSwatch(SwatchColor=RGB(255, 247, 0)))

trigger = Trigger(Interval=100, TimerInterval=100, Target=ghpython_script_2)  # disabled
read_file_2 = ReadFile(File="C:\Users\Zac\Desktop\flag.py", PerLineParse=False)
point_2 = Point([Point(195.7259578, -193.9194438, 412.8221265), Point(195.7259578, -193.9194438, 304.2740422), Point(87.17787351, -193.9194438, 304.2740422), Point(87.17787351, -193.9194438, 195.7259578), Point(195.7259578, -193.9194438, 195.7259578), Point(195.7259578, -193.9194438, 87.17787351), Point(304.2740422, -193.9194438, 87.17787351), Point(304.2740422, -193.9194438, 195.7259578), Point(412.8221265, -193.9194438, 195.7259578), Point(412.8221265, -193.9194438, 304.2740422), Point(304.2740422, -193.9194438, 304.2740422), Point(304.2740422, -193.9194438, 412.8221265)])
ghpython_script_2 = GhPythonScript(Code=read_file_2, Patterns=point_2)  # -> Out, FlagLine1, FlagLine2, Flag, Cross
custom_preview_3 = CustomPreview(Geometry=ghpython_script_2.Flag, Material=ColourSwatch(SwatchColor=RGB(255, 0, 0)))
custom_preview_4 = CustomPreview(Geometry=ghpython_script_2.Cross, Material=ColourSwatch(SwatchColor=RGB(255, 255, 255)))

populate_geometry = PopulateGeometry(Geometry=sphere, Count=Slider(20, range=0..100), Seed=1)
read_file_3 = ReadFile(File="C:\Users\Zac\Desktop\Classes.py", PerLineParse=False)
ghpython_script_3 = GhPythonScript(
    Code=read_file_3,
    Pts=populate_geometry,
    Distance=Slider(7, range=0..100),
    SphereRadius=Slider(0.718, range=0..1),
    PipeRadius=Slider(0.2, range=0..1))  # -> Out, Objects, Colours
panel_2 = Panel(ghpython_script_3.Objects)
custom_preview_5 = CustomPreview(Geometry=ghpython_script_3.Objects, Material=ghpython_script_3.Colours)
ghpython_script_4 = GhPythonScript(Patterns=[Point(195.7259578, -193.9194438, 412.8221265), Point(195.7259578, -193.9194438, 304.2740422), Point(87.17787351, -193.9194438, 304.2740422), Point(87.17787351, -193.9194438, 195.7259578), Point(195.7259578, -193.9194438, 195.7259578), Point(195.7259578, -193.9194438, 87.17787351), Point(304.2740422, -193.9194438, 87.17787351), Point(304.2740422, -193.9194438, 195.7259578), Point(412.8221265, -193.9194438, 195.7259578), Point(412.8221265, -193.9194438, 304.2740422), Point(304.2740422, -193.9194438, 304.2740422), Point(304.2740422, -193.9194438, 412.8221265)])  # -> out, flagLine1, flagLine2, Flag, Cross; inputs Patterns: list of Point3d
# ---------- ghpython_script_4: Python ----------
# This script is to generate a flag animation

# Import 
from cgitb import reset
import scriptcontext as sc
import Rhino.Geometry as rg
import copy
import math
import Rhino.Geometry.Brep as rb

# Initial variables
flagLength = 500 #mm
flagWidth = 500 #mm
subdivision = 10 #Must be integer
reset = False #In case to initialize

# Wave the flag
def waveFlag (FlagLength, FlagWidth,Amplitude, Subdivision):
    if "wavingVariable" not in sc.sticky or reset:
        sc.sticky["wavingVariable"] = []
        for i in range(subdivision): 
            sc.sticky["wavingVariable"].append(rg.Point3d((FlagLength/(Subdivision-1))*i,math.sin(math.pi * Subdivision/(i+1)) * Amplitude, 0) ) 
    else:
        for i in range (len(sc.sticky["wavingVariable"])):
            tempPointI = copy.deepcopy(sc.sticky["wavingVariable"][i]) 
            if  i == len (sc.sticky["wavingVariable"])-1:
                tempPoint0 = copy.deepcopy(sc.sticky["wavingVariable"][0]) 
                sc.sticky["wavingVariable"][i] = rg.Point3d(tempPointI.X,tempPoint0.Y, 0 ) 
            else: 
                tempPointJ =copy.deepcopy(sc.sticky["wavingVariable"][i+1])  
                sc.sticky["wavingVariable"][i]  = rg.Point3d(tempPointI.X,tempPointJ.Y, 0 )
    return sc.sticky["wavingVariable"]

# Output flag
flagPoints1 =  waveFlag( flagLength, flagWidth, 10, subdivision)
flagLine1 = rg.NurbsCurve.Create(False, 2, flagPoints1)
flagPoints2 = []
for i in flagPoints1:
    flagPoint2 = rg.Point3d(i.X, i.Y, flagWidth)
    flagPoints2.append(flagPoint2) 
flagLine2 =  rg.NurbsCurve.Create(False, 2, flagPoints2)

Flag = rg.NurbsSurface.CreateRuledSurface(flagLine1,flagLine2 )

# Make a cross on the flag
Patterns.append(Patterns[0])
line = rg.PolylineCurve(Patterns) #Cross line
surface = rg.Surface.CreateExtrusion(line, rg.Vector3d(0,300,0)) 
b1 = rb.CreateFromSurface(surface)
b2 = rb.CreateFromSurface(Flag)
splitted = rb.Split(b2, b1, 0.01)


Flag = splitted[0]
Cross = splitted[1]
# ---------- end ghpython_script_4 ----------
