# Grasshopper definition drawNautilus.gh (Grasshopper 1.0.7)
# plug-ins: horsterCameraControl

ghpython_script = GhPythonScript(x=Slider(0.8, range=0..1))  # -> out, a, b
# ---------- ghpython_script: Python ----------
if x <0.25:
    a = x*4
    b =0
if 0.25 <= x and 0.5> x:
    a = 1
    b = (x-0.25)*4
if 0.5<= x and 0.75 >x:
    a = 1- (x-0.5)*4
    b = 1
if 0.75 <= x:
    a =0
    b = 1- (x-0.75)*4
# ---------- end ghpython_script ----------
number_slider = Slider(1, range=0..1)
number_slider_2 = Slider(1, range=0..1)

number_slider_3 = Slider(1, range=0..5)
number_slider_4 = Slider(0.5, range=0..0.5)
number_slider_5 = Slider(80, range=0..100)
number_slider_6 = Slider(1.6, range=0..30)
number_slider_7 = Slider(0.08, range=0..0.1)

colour_picker = ColourPicker(PickedColour=RGB(107, 129, 255))
colour_picker_2 = ColourPicker(PickedColour=RGB(161, 192, 255))
read_file = ReadFile(File="C:\Zac\19 Github\Notes\MASdfab-Week2\drawNautilus.py", PerLineParse=False)
panel = Panel("12")
# Design is a series of informational operations
panel_2 = Panel("Predict Unprediction")
ghpython_script_2 = GhPythonScript(
    Code=read_file,
    NautilusSize=1,
    PiceSize=0.5,
    PiceNumber=80,
    Sharpness=0.08,
    CircleSize=1.6,
    CircleRotation=Slider(0, range=0..1),
    IsSketch=Toggle(True),
    VarX=ghpython_script.a,
    VarY=ghpython_script.b,
    Tolerance=Slider(0.01, range=0..0.1))  # -> Out, Circles, Objects, ColoursU, ColoursV, SketchLines1, SketchLines2, SketchLines3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
colour_picker_3 = ColourPicker(PickedColour=RGB(203, 191, 255))
colour_picker_4 = ColourPicker(PickedColour=RGB(151, 133, 255))
panel_3 = Panel(ghpython_script_2.Out)
panel_4 = Panel(ghpython_script_2.SketchLines1)
curve_display = CurveDisplay(
    Curve=ghpython_script_2.SketchLines1,
    Width=Slider(0.5, range=0..1),
    Colour=ColourSwatch(SwatchColor=RGBA(207, 207, 207, 186)))  # inputs Curve: Curve, Width: Int32, Colour: Color, Dash: String
# ---------- curve_display: C# ----------
    if (Curve == null) return;
    if (Width <= 0) return;

    double[] pattern = ParseDashPattern(Dash);
    IEnumerable<Curve> segments = ApplyDashPattern(Curve, pattern);

    _clip = BoundingBox.Union(_clip, Curve.GetBoundingBox(false));
    foreach (Curve segment in segments)
    {
      _curves.Add(segment);
      _colors.Add(Colour);
      _widths.Add(Width);
    }
# ---------- curve_display: C# additional code ----------
  /// <summary>
  /// Parse a dash pattern.
  /// </summary>
  /// <param name="pattern">Pattern to parse.</param>
  /// <returns>Array of dashes and gaps.</returns>
  private double[] ParseDashPattern(string pattern)
  {
    if (string.IsNullOrWhiteSpace(pattern))
      return null;

    string[] fragments = pattern.Split(new char[] {' '});
    if (fragments == null || fragments.Length == 0)
      return null;

    double[] values = new double[fragments.Length];
    for (int i = 0; i < fragments.Length; i++)
    {
      double v;
      if (!double.TryParse(fragments[i], out v))
        throw new Exception(fragments[i] + " is a not a valid number.");

      if (v <= 0.0)
        throw new Exception("Dashes or gaps must have a strictly positive length.");

      values[i] = v;
    }

    return values;
  }
  /// <summary>
  /// Apply a dash+gap pattern to a curve.
  /// </summary>
  private IEnumerable<Curve> ApplyDashPattern(Curve curve, double[] pattern)
  {
    if (pattern == null || pattern.Length == 0)
      return new Curve[] { curve };

    double curveLength = curve.GetLength();
    List<Curve> dashes = new List<Curve>();

    double offset0 = 0.0;
    int index = 0;
    while(true)
    {
      // Get the current dash length.
      double dashLength = pattern[index++];
      if (index >= pattern.Length)
        index = 0;

      // Compute the offset of the current dash from the curve start.
      double offset1 = offset0 + dashLength;
      if (offset1 > curveLength)
        offset1 = curveLength;

      // Solve the curve parameters at the current dash start and end.
      double t0, t1;
      curve.LengthParameter(offset0, out t0);
      curve.LengthParameter(offset1, out t1);

      Curve dash = curve.Trim(t0, t1);
      if (dash != null)
        dashes.Add(dash);

      // Get the current gap length.
      double gapLength = pattern[index++];
      if (index >= pattern.Length)
        index = 0;

      // Set the start of the next dash to be the end of the current
      // dash + the length of the adjacent gap.
      offset0 = offset1 + gapLength;

      // Abort when we've reached the end of the curve.
      if (offset0 >= curveLength)
        break;
    }

    return dashes;
  }

  private BoundingBox _clip;
  private readonly List<Curve> _curves = new List<Curve>();
  private readonly List<Color> _colors = new List<Color>();
  private readonly List<int> _widths = new List<int>();

  /// <summary>
  /// This method will be called once every solution, before any calls to RunScript.
  /// </summary>
  public override void BeforeRunScript()
  {
    _clip = BoundingBox.Empty;
    _curves.Clear();
    _colors.Clear();
    _widths.Clear();
  }

  /// <summary>
  /// Return a BoundingBox that contains all the geometry you are about to draw.
  /// </summary>
  public override BoundingBox ClippingBox
  {
    get { return _clip; }
  }
  /// <summary>
  /// Draw all wires and points in this method.
  /// </summary>
  public override void DrawViewportWires(IGH_PreviewArgs args)
  {
    for (int i = 0; i < _curves.Count; i++)
      args.Display.DrawCurve(_curves[i], _colors[i], _widths[i]);
  }
# ---------- end curve_display ----------
curve_display_2 = CurveDisplay(
    Curve=ghpython_script_2.SketchLines2,
    Width=Slider(0.5, range=0..1),
    Colour=ColourSwatch(SwatchColor=RGBA(207, 207, 207, 74)))  # inputs Curve: Curve, Width: Int32, Colour: Color, Dash: String; same code as curve_display
curve_display_3 = CurveDisplay(
    Curve=ghpython_script_2.SketchLines3,
    Width=Slider(0.5, range=0..1),
    Colour=ColourSwatch(SwatchColor=RGBA(171, 171, 171, 86)))  # inputs Curve: Curve, Width: Int32, Colour: Color, Dash: String; same code as curve_display
curve_display_4 = CurveDisplay(Curve=ghpython_script_2.Objects, Width=Slider(1, range=0..10), Colour=ghpython_script_2.ColoursV)  # inputs Curve: Curve, Width: Int32, Colour: Color, Dash: String; same code as curve_display
curve_display_5 = CurveDisplay(
    Curve=ghpython_script_2.SketchLines4,
    Width=Slider(0.5, range=0..1),
    Colour=ColourSwatch(SwatchColor=RGBA(168, 168, 168, 95)))  # inputs Curve: Curve, Width: Int32, Colour: Color, Dash: String; same code as curve_display
curve_display_6 = CurveDisplay(Curve=ghpython_script_2.Circles, Width=Slider(0.8, range=0..1), Colour=ghpython_script_2.ColoursU)  # inputs Curve: Curve, Width: Int32, Colour: Color, Dash: String; same code as curve_display
construct_point = ConstructPoint(XCoordinate=0, YCoordinate=0, ZCoordinate=0)
geometry = Geometry(ghpython_script_2.SketchLines5)
number_slider_8 = Slider(0.5, range=0..1)
line = Line(StartPoint=construct_point, EndPoint=geometry)
evaluate_curve = EvaluateCurve(Curve=line, Parameter=Slider(0.2, range=0..1))  # -> Point, Tangent, Angle
number_slider_9 = Slider(50, range=0..100)
construct_point_2 = ConstructPoint(XCoordinate=0, YCoordinate=0, ZCoordinate=0)
set_camera = SetCamera(
    CameraLocation=construct_point_2,
    TargetLocation=evaluate_curve.Point,
    LensLength=Slider(30, range=0..1000),
    Activate=Toggle(True))
