# Grasshopper definition flocksTask.gh (Grasshopper 1.0.7)

number_slider = Slider(1000, range=0..1000)
number_slider_2 = Slider(100, range=0..100)
# Z
_0_to_1_00 = Slider(0, range=0..1)
_1_to_100 = Slider(0, range=0..100)
ghpython_script = GhPythonScript()  # -> Out, A
vector_xyz = VectorXYZ(XComponent=0, YComponent=Slider(0.74, range=0..1), ZComponent=Slider(0, range=0..1))  # -> Vector, Length
read_file = ReadFile(File="C:\Users\Zac\Desktop\flocksTask\flocksTask.py", PerLineParse=False)
c_script = CSharpScript()  # -> Out, A
trigger = Trigger(Interval=10, TimerInterval=10, Target=ghpython_script_2)  # disabled
ghpython_script_2 = GhPythonScript(Code=read_file, Count=Slider(10, range=0..10), Force=vector_xyz.Vector, Boundary=number_slider_2, Reset=Button())  # -> Out, Trajectories, Spheres
sphere = Sphere(Base=PlaneXY(0, 0, 0), Radius=number_slider_2)
center_box = CenterBox(Base=PlaneXY(0, 0, 0), X=number_slider_2, Y=number_slider_2, Z=number_slider_2)
custom_preview = CustomPreview(Geometry=sphere, Material=ColourSwatch(SwatchColor=RGBA(255, 255, 255, 43)))
