# Grasshopper definition LSystem.gh (Grasshopper 1.0.7)

# Z
_0_to_1_00 = Slider(0, range=0..1)
_1_to_100 = Slider(0, range=0..100)
read_file = ReadFile(File="C:\Zac\19 Github\Notes\MASdfab-Week3-4\LSystem.py", PerLineParse=False)
c_script = CSharpScript()  # -> Out, A
ghpython_script = GhPythonScript(
    Code=read_file,
    Iteration=Slider(5, range=0..10),
    Rotation=Slider(17, range=0..100),
    Angle=Slider(80, range=0..100),
    Length=Slider(6, range=0..10))  # -> Out, L_system
