# Grasshopper definition Mandelbrot_v3.gh (Grasshopper 1.0.7)

# ---- group: this change the Roughness of x,y,z. Play with the paras. Suggest 0-100
number_slider = Slider(0, range=0..100)
number_slider_2 = Slider(50, range=0..100)
number_slider_3 = Slider(50, range=0..100)

# ---- group: Input mesh. Should be closed and simple. Can be a list of meshes
geometry = Geometry(<brep referenced from the Rhino model>)

# ----
presetting_the_location_of_csv_file = Panel("C:\Zac\19 Github\Notes\MASdfab-Week5\DIM32.csv")
read_file = ReadFile(File="C:\Zac\19 Github\Notes\MASdfab-Week5\Mandelbrot_v3.py", PerLineParse=False)

# ---- group: DO NOT TOUCH
series = Series(Start=0, Step="0.1", Count="11")

# ---- group: Select the color you love!
gradient = Gradient(
    LowerLimit=0,
    UpperLimit=1,
    Parameter=series,
    stops=[0: RGB(234, 38, 0), 0.25: RGB(234, 126, 0), 0.5: RGB(254, 244, 84), 0.75: RGB(173, 203, 249), 1: RGB(75, 107, 169)])
gradient_2 = Gradient(
    LowerLimit=0,
    UpperLimit=1,
    Parameter=series,
    stops=[0: RGBA(0, 0, 0, 0), 0.25: RGB(129, 143, 70), 0.5: RGB(128, 85, 58), 0.75: RGB(173, 203, 249), 1: RGB(176, 181, 197)])
gradient_3 = Gradient(LowerLimit=0, UpperLimit=1, Parameter=series, stops=[0: RGB(255, 255, 255), 1: RGB(0, 0, 0)])
gradient_4 = Gradient(
    LowerLimit=0,
    UpperLimit=1,
    Parameter=series,
    stops=[0: RGB(0, 98, 0), 0.25: RGB(81, 175, 17), 0.5: RGB(159, 198, 146), 0.75: RGB(170, 235, 41), 1: RGB(221, 255, 53)])

# ---- group: DO NOT TOUCH
area = Area(Geometry=geometry)  # -> Area, Centroid
move = Move(Geometry=geometry, Motion=expr("-x", area.Centroid))  # -> Geometry, Transform
ghpython_script = GhPythonScript(
    Code=read_file,
    InTemp=move.Geometry,
    XRoughness=number_slider,
    YRoughness=number_slider_2,
    ZRoughness=number_slider_3,
    Colors=reverse(gradient),
    Location=presetting_the_location_of_csv_file)  # -> Out, OutTemp, X
move_2 = Move(Geometry=ghpython_script.OutTemp, Motion=area.Centroid)  # -> Geometry, Transform

# ---- group: OUTPUT
mesh = Mesh(move_2.Geometry)

# ----
panel = Panel(ghpython_script.Out)
